vi "index.gviweb"   [G Web Development Software 22.0.0]
panel controls:
  "konsentrat": f64
  "vann": f64
  "ferdig blandet": f64
  "lagertank": f64
  "Start blanding": bool
  "Pause": bool
panel indicators:
  "0, 1": i16
  "0, 1_2": i16
  "tid": i32
  "start blandingen": bool
  "LED": bool
  "LED_2": bool
  "LED_3": bool
  "LED_4": bool
  "LED_5": bool
  "LED_6": bool
  "LED_7": bool
  "LED_8": bool
  "LED_9": bool
  "LED_10": bool
  "LED_11": bool
  "LED_12": bool
  "LED_13": bool
  "LED_14": bool
  "LED_15": bool
  "LED_16": bool
  "LED_17": bool
  "LED_18": bool
  "LED_19": bool
  "LED_20": bool
  "LED_21": bool
  "LED_22": bool
  "LED_23": bool
  "LED_24": bool
  "LED_25": bool
  "LED_26": bool
  "Nivå ferdig blandet": f64
  "Nivå lagertank": f64
  "Nivå konsentrat": f64
  "Nivå vann": f64
  "LED_27": bool
  "LED_28": bool
  "LED_29": bool
  "LED_30": bool
  "LED_31": bool
  "LED_32": bool
  "URL Image": string
  "LED_34": bool
  "LED_35": bool
  "LED_36": bool
  "LED_37": bool
  "LED_38": bool
  "LED_39": bool
  "LED_40": bool
  "LED_41": bool
  "LED_42": bool
  "LED_43": bool
  "LED_44": bool
  "LED_45": bool
  "LED_46": bool
  "LED_47": bool
  "LED_48": bool
  "LED_49": bool
  "LED_50": bool
  "LED_51": bool
  "LED_52": bool
  "LED_53": bool
  "LED_54": bool
  "LED_55": bool
  "URL Image_2": string
  "URL Image_3": string
  "LED_33": bool
  "LED_56": bool
  "LED_57": bool
  "LED_58": bool
  "URL Image_4": string
  "LED_59": bool
  "LED_60": bool
  "LED_61": bool
  "LED_62": bool
  "LED_63": bool
  "LED_64": bool
  "LED_65": bool
  "LED_66": bool
  "LED_67": bool
diagram:
  while {
    w1 = $"Start blanding"
    case (w1) {
      frame False, Default { }
      frame True {
        s1 = $vann  # shift register
        s2 = $konsentrat  # shift register
        s3 = $"ferdig blandet"  # shift register
        s4 = $lagertank  # shift register
        while (iteration -> i1) {
          Is Less(x=$"Nivå lagertank", y=86) -> w2
          $LED_50 <- w2
          $LED_51 <- w2
          Is Greater(x=s3, y=10) -> w3
          Is Greater(x=$"Nivå lagertank", y=10) -> w4
          Is Greater(x=$tid, y=75) -> w5
          Logical And(w2, w4, w3, w5) -> w6
          $LED_60 <- w6
          $LED_61 <- w6
          $LED_52 <- w2
          $LED_62 <- w6
          $LED_53 <- w2
          $LED_63 <- w6
          Logical And($LED_23, $LED_19) -> w7
          $LED_67 <- w7
          $LED_54 <- w6
          $LED_66 <- w7
          $LED_55 <- w6
          $LED_29 <- w7
          $LED_28 <- w7
          $LED_44 <- w5
          Is Greater(x=s2, y=15) -> w8
          Multiply($"0, 1_2", 1) -> w9
          Multiply(w9, 1) -> w10
          Multiply($"0, 1", 1) -> w11
          Add(w10, w11) -> w12
          Add(w12, s3) -> w13
          Is Less(x=w13, y=95) -> w14
          Logical And(w8, w14) -> w15
          Is Less(x=$tid, y=15) -> w16
          Logical And(w15, w16) -> w17
          $LED_38 <- w17
          Not(x=w5) -> w18
          $LED_30 <- w18
          $LED_37 <- w17
          $LED_45 <- w5
          $LED_27 <- w7
          $LED_26 <- w18
          $tid <- i1
          $LED_18 <- w17
          $LED_46 <- w5
          $LED_25 <- w18
          Wait(time to wait=500)
          Boolean To 0 Or 1(Boolean=w17) -> (0, 1=w19)
          $"0, 1_2" <- w19
          $LED_24 <- w18
          $LED_17 <- w15
          $LED_47 <- w5
          $LED_23 <- w18
          $LED_7 <- w15
          Not(x=w15) -> w20
          $LED_5 <- w20
          $LED_4 <- w15
          In Range And Coerce(lower limit=15, upper limit=75, x=$tid) -> (In Range?=w21)
          Is Greater(x=s1, y=15) -> w22
          Logical And(w21, w22) -> w23
          Logical And(w23, w14) -> w24
          Boolean To 0 Or 1(Boolean=w24) -> (0, 1=w25)
          $"0, 1" <- w25
          $LED_13 <- w14
          Subtract(x=s1, y=w11) -> w26
          $"Nivå vann" <- w26
          Select(s=w6, t=5, f=0) -> w27
          Subtract(x=w13, y=w27) -> w28
          $"Nivå ferdig blandet" <- w28
          $LED_14 <- w14
          $vann <- w26
          $"ferdig blandet" <- w28
          $LED_35 <- w17
          $LED_3 <- w14
          $LED_34 <- w17
          $LED_2 <- w14
          $LED_6 <- w17
          Not(x=w17) -> w29
          $LED_19 <- w29
          $LED_32 <- w29
          $LED_8 <- w17
          $LED_41 <- w29
          $LED_36 <- w17
          $LED_42 <- w29
          $LED_64 <- w17
          Multiply(w27, 1.5) -> w30
          Add(w30, s4) -> w31
          $lagertank <- w31
          $LED_48 <- w3
          $LED_65 <- w17
          $"Nivå lagertank" <- w31
          $LED_49 <- w3
          Subtract(x=s2, y=w9) -> w32
          $konsentrat <- w32
          $LED_10 <- w1
          $LED_39 <- w15
          $"start blandingen" <- w1
          $"Nivå konsentrat" <- w32
          $LED_21 <- w15
          $LED_11 <- w1
          $LED_15 <- w15
          $LED_20 <- w15
          $LED_9 <- w1
          $LED_22 <- w15
          Not(x=w1) -> w33
          $LED <- w1
          $LED_31 <- w15
          $LED_43 <- w15
          case ($Pause) {
            frame False, Default { }
            frame True {
              while {
                Not(x=$Pause) -> w34
                stop if w34
              }
            }
          }
          next s1 = w26
          next s2 = w32
          next s3 = w28
          next s4 = w31
          stop if w33
        }
      }
    }
    $LED_10 <- w1
    $LED_9 <- w1
    $LED_11 <- w1
    stop if FALSE
  }
  $"Nivå lagertank" <- 16
  $vann <- 100
  $"Nivå ferdig blandet" <- 0
  $konsentrat <- 100
  $lagertank <- 16
  $"ferdig blandet" <- 12
  $"Nivå konsentrat" <- 100
  $tid <- 0
  $"Nivå vann" <- 100
  $"start blandingen" <- FALSE
  $LED <- FALSE
  $LED_2 <- TRUE
  $"Start blanding" <- FALSE
  $LED_3 <- TRUE
  $LED_4 <- FALSE
  $LED_5 <- TRUE
  $LED_6 <- FALSE
  $LED_12 <- TRUE
  $LED_7 <- FALSE
  $LED_13 <- TRUE
  $LED_14 <- TRUE
  $LED_15 <- FALSE
  $LED_17 <- FALSE
  $LED_8 <- TRUE
  $LED_18 <- FALSE
  $LED_19 <- FALSE
  $LED_20 <- FALSE
  $LED_23 <- TRUE
  $LED_21 <- FALSE
  $LED_24 <- TRUE
  $LED_25 <- TRUE
  $LED_22 <- FALSE
  $LED_26 <- TRUE
  $LED_27 <- FALSE
  $LED_28 <- FALSE
  $LED_30 <- TRUE
  $LED_29 <- FALSE
  $LED_33 <- TRUE
  $LED_48 <- TRUE
  $LED_31 <- FALSE
  $LED_49 <- TRUE
  $LED_32 <- FALSE
  $LED_50 <- TRUE
  $LED_34 <- FALSE
  $LED_51 <- TRUE
  $LED_35 <- FALSE
  $LED_52 <- TRUE
  $LED_36 <- FALSE
  $LED_53 <- TRUE
  $LED_37 <- FALSE
  $LED_56 <- TRUE
  $LED_38 <- FALSE
  $LED_57 <- TRUE
  $LED_39 <- FALSE
  $LED_58 <- TRUE
  $LED_41 <- FALSE
  $LED_59 <- TRUE
  $LED_42 <- FALSE
  $LED_43 <- FALSE
  $LED_44 <- FALSE
  $LED_45 <- FALSE
  $LED_46 <- FALSE
  $LED_47 <- FALSE
  $LED_54 <- FALSE
  $LED_55 <- FALSE
